test file "ETRSTests"
  coverage: Decision, MCDC, SignalRange, SimulinkDesignVerifier, RelationalBoundary, Condition, LookupTable, SignalSize, SaturationOnIntOverflow

suite "ETRS1"

  case "ETRS_1_1Chng2Park" [baseline]
    model DevChallengeETRS, stop time 35
    input "ETRSInputs - Advanced Case - 1.1.mat", mapped to ElectronicTransmissionRangeSel, ParktoChargeRequested, ElectricParkBrakeAvailable, ElectricParkBrakeApplied, Park_BrakePressed, VehicleSpeed, HVShutdownRequested, VehicleSystemEnabled (active)

  case "ETRS_1_1_1StayPark" [baseline]
    model DevChallengeETRS, mode Normal, start time 0, stop time 35
    input "ETRSInputs - Advanced Case - 1.1.1.mat", mapped to ElectronicTransmissionRangeSel, ParktoChargeRequested, ElectricParkBrakeAvailable, ElectricParkBrakeApplied, Park_BrakePressed, VehicleSpeed, HVShutdownRequested, VehicleSystemEnabled (active)

  case "ETRS_1_2Chng2Rvrs" [baseline]
    model DevChallengeETRS, mode Normal, start time 0, stop time 35
    input "ETRS_in_r1_test2_1.mat", mapped to ElectronicTransmissionRangeSel, ParktoChargeRequested, ElectricParkBrakeAvailable, ElectricParkBrakeApplied, Park_BrakePressed, VehicleSpeed, HVShutdownRequested, VehicleSystemEnabled
    input "ETRSInputs.mat", mapped to ElectronicTransmissionRangeSel, ParktoChargeRequested, ElectricParkBrakeAvailable, ElectricParkBrakeApplied, Park_BrakePressed, VehicleSpeed, HVShutdownRequested, VehicleSystemEnabled (active)
    assessment "Assessment1": At any point of time, whenever ElectronicTransmissionRangeSel == 2 & ElectricParkBrakeApplied == 2 & VehicleSystemEnabled == 1 is true then, with a delay of at most 0.05, TransmissionPosition == 3 must be true
      ElectronicTransmissionRangeSel: signal DevChallengeETRS/ElectronicTransmissionRangeSel, port 1
      ElectricParkBrakeApplied: signal DevChallengeETRS/ElectricParkBrakeApplied, port 1
      VehicleSystemEnabled: signal DevChallengeETRS/VehicleSystemEnabled, port 1
      TransmissionPosition: signal DevChallengeETRS/ETRS State Machine, port 1

  case "ETRS_1_3Chng2Ntrl" [baseline]
    model DevChallengeETRS, mode Normal, start time 0, stop time 35
    input "ETRS_in_r1_test3_1.mat", mapped to ElectronicTransmissionRangeSel, ParktoChargeRequested, ElectricParkBrakeAvailable, ElectricParkBrakeApplied, Park_BrakePressed, VehicleSpeed, HVShutdownRequested, VehicleSystemEnabled
    input "ETRS_in_r1_test3_2.mat", mapped to ElectronicTransmissionRangeSel, ParktoChargeRequested, ElectricParkBrakeAvailable, ElectricParkBrakeApplied, Park_BrakePressed, VehicleSpeed, HVShutdownRequested, VehicleSystemEnabled
    input "ETRSInputs.mat", mapped to ElectronicTransmissionRangeSel, ParktoChargeRequested, ElectricParkBrakeAvailable, ElectricParkBrakeApplied, Park_BrakePressed, VehicleSpeed, HVShutdownRequested, VehicleSystemEnabled (active)
    assessment "Assessment1" (off): At any point of time, whenever ElectronicTransmissionRangeSel == 3 is true then, with a delay of at most 0.05, TransmissionPosition == 5 must be true
    assessment "Assessment2": At any point of time, whenever ElectronicTransmissionRangeSel == 4 is true then, with a delay of at most 0.05, TransmissionPosition == 7 must be true
      ElectronicTransmissionRangeSel: signal DevChallengeETRS/ElectronicTransmissionRangeSel, port 1
      TransmissionPosition: signal DevChallengeETRS/ETRS State Machine, port 1

  case "ETRS_1_4Chng2Drv" [baseline]
    model DevChallengeETRS, mode Normal, start time 0, stop time 35
    input "ETRS_in_r1_test4_1.mat", mapped to ElectronicTransmissionRangeSel, ParktoChargeRequested, ElectricParkBrakeAvailable, ElectricParkBrakeApplied, Park_BrakePressed, VehicleSpeed, HVShutdownRequested, VehicleSystemEnabled
    input "ETRS_in_r1_test4_2.mat", mapped to ElectronicTransmissionRangeSel, ParktoChargeRequested, ElectricParkBrakeAvailable, ElectricParkBrakeApplied, Park_BrakePressed, VehicleSpeed, HVShutdownRequested, VehicleSystemEnabled
    input "ETRSInputs.mat", mapped to ElectronicTransmissionRangeSel, ParktoChargeRequested, ElectricParkBrakeAvailable, ElectricParkBrakeApplied, Park_BrakePressed, VehicleSpeed, HVShutdownRequested, VehicleSystemEnabled (active)
    assessment "Assessment1" (off): At any point of time, whenever ElectronicTransmissionRangeSel == 4 & ElectricParkBrakeApplied == 2 & VehicleSystemEnabled == 1 is true then, with a delay of at most 0.05, TransmissionPosition == 7 must be true
    assessment "TemporalCase_sucessAfter_t10Assessment2": At any point of time, whenever ElectronicTransmissionRangeSel == 4 & ElectricParkBrakeApplied == 2 & VehicleSystemEnabled == 1 is true then, with a delay of at most 0.05, TransmissionPosition == 7 must be true
      ElectronicTransmissionRangeSel: signal DevChallengeETRS/ElectronicTransmissionRangeSel, port 1
      ElectricParkBrakeApplied: signal DevChallengeETRS/ElectricParkBrakeApplied, port 1
      VehicleSystemEnabled: signal DevChallengeETRS/VehicleSystemEnabled, port 1
      TransmissionPosition: signal DevChallengeETRS/ETRS State Machine, port 1

suite "ETRS2"

  case "ETRS_2_1EPB_DrvRvrs_Ntrl" [baseline]
    model DevChallengeETRS, mode Normal, start time 0, stop time 35
    input "ETRSInputs - 2.1 - 1.mat", mapped to ElectronicTransmissionRangeSel, ParktoChargeRequested, ElectricParkBrakeAvailable, ElectricParkBrakeApplied, Park_BrakePressed, VehicleSpeed, HVShutdownRequested, VehicleSystemEnabled
    input "ETRSInputs.mat", mapped to ElectronicTransmissionRangeSel, ParktoChargeRequested, ElectricParkBrakeAvailable, ElectricParkBrakeApplied, Park_BrakePressed, VehicleSpeed, HVShutdownRequested, VehicleSystemEnabled
    input "ETRS_in_r2_test1 - AdvCase_Yes_Brake.mat", mapped to ElectronicTransmissionRangeSel, ParktoChargeRequested, ElectricParkBrakeAvailable, ElectricParkBrakeApplied, Park_BrakePressed, VehicleSpeed, HVShutdownRequested, VehicleSystemEnabled
    input "ETRS_in_r2_test1 - AdvCase_NoBrake_Drive.mat", mapped to ElectronicTransmissionRangeSel, ParktoChargeRequested, ElectricParkBrakeAvailable, ElectricParkBrakeApplied, Park_BrakePressed, VehicleSpeed, HVShutdownRequested, VehicleSystemEnabled
    assessment "BaseCase": At any point of time, whenever (ElectronicTransmissionRangeSel == 2 | ElectronicTransmissionRangeSel == 4) & ElectricParkBrakeApplied == 1 is true then, with a delay of at most 0.05, TransmissionPosition == 5 must be true
    assessment "AdvCase_NoBrake_Rev": At any point of time, whenever (ElectronicTransmissionRangeSel == 2) & ElectricParkBrakeApplied == 2 is true then, with a delay of at most 0.05, TransmissionPosition == 1| TransmissionPosition == 3 | TransmissionPosition == 5 must be true
    assessment "AdvCase_NoBrake_drive": At any point of time, whenever (ElectronicTransmissionRangeSel == 4) & ElectricParkBrakeApplied == 2 is true then, with a delay of at most 0.05, TransmissionPosition == 1 | TransmissionPosition == 5 | TransmissionPosition == 7 must be true
      ElectronicTransmissionRangeSel: signal DevChallengeETRS/ElectronicTransmissionRangeSel, port 1
      ElectricParkBrakeApplied: signal DevChallengeETRS/ElectricParkBrakeApplied, port 1
      TransmissionPosition: signal DevChallengeETRS/ETRS State Machine, port 1

  case "ETRS_2_2EPB_Prk_Ntrl" [baseline]
    model DevChallengeETRS, mode Normal, start time 0, stop time 35
    input "ETRS_in_r2_test2_1 .mat", mapped to ElectronicTransmissionRangeSel, ParktoChargeRequested, ElectricParkBrakeAvailable, ElectricParkBrakeApplied, Park_BrakePressed, VehicleSpeed, HVShutdownRequested, VehicleSystemEnabled
    input "ETRS_in_r2_test2_3.mat", mapped to ElectronicTransmissionRangeSel, ParktoChargeRequested, ElectricParkBrakeAvailable, ElectricParkBrakeApplied, Park_BrakePressed, VehicleSpeed, HVShutdownRequested, VehicleSystemEnabled
    input "ETRS_in_r2_test2_2.mat", mapped to ElectronicTransmissionRangeSel, ParktoChargeRequested, ElectricParkBrakeAvailable, ElectricParkBrakeApplied, Park_BrakePressed, VehicleSpeed, HVShutdownRequested, VehicleSystemEnabled
    input "ETRSInputs.mat", mapped to ElectronicTransmissionRangeSel, ParktoChargeRequested, ElectricParkBrakeAvailable, ElectricParkBrakeApplied, Park_BrakePressed, VehicleSpeed, HVShutdownRequested, VehicleSystemEnabled (active)
    assessment "BaseCase": At any point of time, whenever (ElectronicTransmissionRangeSel == 1 | ParktoChargeRequested == 1) & (ElectricParkBrakeApplied == 2) is true then, with a delay of at most 0.05, TransmissionPosition == 5 must be true
      ElectronicTransmissionRangeSel: signal DevChallengeETRS/ElectronicTransmissionRangeSel, port 1
      ParktoChargeRequested: signal DevChallengeETRS/ParktoChargeRequested, port 1
      ElectricParkBrakeApplied: signal DevChallengeETRS/ElectricParkBrakeApplied, port 1
      TransmissionPosition: signal DevChallengeETRS/ETRS State Machine, port 1

  case "ETRS_2_1EPB_DrvRvrs_Ntrl_AdvCase1" [baseline]
    description: If "ElectronicTransmissionRangeSel" indicates REVERSE(2) and the ElectricParkBrakeApplied is False(2), the PSC shall indicate NEUTRAL,REVERSE, or PARK via "TransmissionPosition"
    model DevChallengeETRS, mode Normal, start time 0, stop time 35
    input "ETRS_in_r2_test1 - AdvCase_NoBrake_Rev.mat", mapped to ElectronicTransmissionRangeSel, ParktoChargeRequested, ElectricParkBrakeAvailable, ElectricParkBrakeApplied, Park_BrakePressed, VehicleSpeed, HVShutdownRequested, VehicleSystemEnabled (active)
    assessment "AdvCase_NoBrake_Rev": At any point of time, whenever (ElectronicTransmissionRangeSel == 2) & ElectricParkBrakeApplied == 2 is true then, with a delay of at most 0.05, TransmissionPosition == 1| TransmissionPosition == 3 | TransmissionPosition == 5 must be true
      ElectronicTransmissionRangeSel: signal DevChallengeETRS/ElectronicTransmissionRangeSel, port 1
      ElectricParkBrakeApplied: signal DevChallengeETRS/ElectricParkBrakeApplied, port 1
      TransmissionPosition: signal DevChallengeETRS/ETRS State Machine, port 1

  case "ETRS_2_1EPB_DrvRvrs_Ntrl_AdvCase2" [baseline]
    description: If "ElectronicTransmissionRangeSel" indicates DRIVE(4) and the ElectricParkBrakeApplied is False(2), the PSC shall indicate NEUTRAL,DRIVE, or PARK via "TransmissionPosition"
    model DevChallengeETRS, mode Normal, start time 0, stop time 35
    input "ETRS_in_r2_test1 - AdvCase_NoBrake_Drive.mat", mapped to ElectronicTransmissionRangeSel, ParktoChargeRequested, ElectricParkBrakeAvailable, ElectricParkBrakeApplied, Park_BrakePressed, VehicleSpeed, HVShutdownRequested, VehicleSystemEnabled (active)
    assessment "AdvCase_NoBrake_drive": At any point of time, whenever (ElectronicTransmissionRangeSel == 4) & ElectricParkBrakeApplied == 2 is true then, with a delay of at most 0.05, TransmissionPosition == 1 | TransmissionPosition == 5 | TransmissionPosition == 7 must be true
      ElectronicTransmissionRangeSel: signal DevChallengeETRS/ElectronicTransmissionRangeSel, port 1
      ElectricParkBrakeApplied: signal DevChallengeETRS/ElectricParkBrakeApplied, port 1
      TransmissionPosition: signal DevChallengeETRS/ETRS State Machine, port 1

  case "ETRS_2_2EPB_Prk_Ntrl_AdvCase1" [baseline]
    description: If "ElectronicTransmissionRangeSel" indicates PARK(1) or "ParktoChargeRequested" is True(1) and the "ElectricParkBrakeApplied" is False(1), the PSC shall indicate NEUTRAL or PARK via "TransmissionPosition"
    model DevChallengeETRS, mode Normal, start time 0, stop time 35
    input "ETRS_in_r2_test2_1 .mat", mapped to ElectronicTransmissionRangeSel, ParktoChargeRequested, ElectricParkBrakeAvailable, ElectricParkBrakeApplied, Park_BrakePressed, VehicleSpeed, HVShutdownRequested, VehicleSystemEnabled
    input "ETRS_in_r2_test2_3.mat", mapped to ElectronicTransmissionRangeSel, ParktoChargeRequested, ElectricParkBrakeAvailable, ElectricParkBrakeApplied, Park_BrakePressed, VehicleSpeed, HVShutdownRequested, VehicleSystemEnabled
    input "ETRS_in_r2_test2_2.mat", mapped to ElectronicTransmissionRangeSel, ParktoChargeRequested, ElectricParkBrakeAvailable, ElectricParkBrakeApplied, Park_BrakePressed, VehicleSpeed, HVShutdownRequested, VehicleSystemEnabled
    input "ETRSInputs.mat", mapped to ElectronicTransmissionRangeSel, ParktoChargeRequested, ElectricParkBrakeAvailable, ElectricParkBrakeApplied, Park_BrakePressed, VehicleSpeed, HVShutdownRequested, VehicleSystemEnabled
    input "ETRS_in_r2_test2 - AdvCase_Yes_Brake.mat", mapped to ElectronicTransmissionRangeSel, ParktoChargeRequested, ElectricParkBrakeAvailable, ElectricParkBrakeApplied, Park_BrakePressed, VehicleSpeed, HVShutdownRequested, VehicleSystemEnabled (active)
    assessment "AdvTest1_Yes_Brake": At any point of time, whenever (ElectronicTransmissionRangeSel == 1 | ParktoChargeRequested == 1) & (ElectricParkBrakeApplied == 1) is true then, with a delay of at most 0.05, TransmissionPosition == 1 | TransmissionPosition == 5 must be true
      ElectronicTransmissionRangeSel: signal DevChallengeETRS/ElectronicTransmissionRangeSel, port 1
      ParktoChargeRequested: signal DevChallengeETRS/ParktoChargeRequested, port 1
      ElectricParkBrakeApplied: signal DevChallengeETRS/ElectricParkBrakeApplied, port 1
      TransmissionPosition: signal DevChallengeETRS/ETRS State Machine, port 1

suite "ETRS3"

  case "ETRS_3_1PrkSpd" [baseline]
    model DevChallengeETRS, mode Normal, start time 0, stop time 35
    input "ETRSInputs.mat", mapped to ElectronicTransmissionRangeSel, ParktoChargeRequested, ElectricParkBrakeAvailable, ElectricParkBrakeApplied, Park_BrakePressed, VehicleSpeed, HVShutdownRequested, VehicleSystemEnabled (active)
    assessment "Assessment1": At any point of time, whenever (VehicleSpeed < 0.5)&(ElectronicTransmissionRangeSel == 1)&(ElectricParkBrakeApplied == 1)&(ElectricParkBrakeAvailable == 1) is true then, with a delay between 0 and 0.02, ElectronicTransmissionRangeState == 0 must be true
      VehicleSpeed: signal DevChallengeETRS/VehicleSpeed, port 1
      ElectronicTransmissionRangeSel: signal DevChallengeETRS/ElectronicTransmissionRangeSel, port 1
      ElectricParkBrakeApplied: signal DevChallengeETRS/ElectricParkBrakeApplied, port 1
      ElectricParkBrakeAvailable: signal DevChallengeETRS/ElectricParkBrakeAvailable, port 1
      ElectronicTransmissionRangeState: signal DevChallengeETRS/ETRS State Machine, port 7

  case "ETRS_3_1PrkSpd_Fail" [baseline]
    description: Park Blocked When Moving (3.1 Fail Case)
      Speed is kept at 0.6 (above the required 0.5 to park) driver still requests park and EPB is ok. Proves the model does not enter park when speed is above 0.5
    model DevChallengeETRS, mode Normal, start time 0, stop time 35
    input "ETRSInputs_3.1_Fail.mat", mapped to ElectronicTransmissionRangeSel, ParktoChargeRequested, ElectricParkBrakeAvailable, ElectricParkBrakeApplied, Park_BrakePressed, VehicleSpeed, HVShutdownRequested, VehicleSystemEnabled (active)
    assessment "Assessment1": At any point of time, whenever (VehicleSpeed < 0.5)&(ElectronicTransmissionRangeSel == 1)&(ElectricParkBrakeApplied == 1)&(ElectricParkBrakeAvailable == 1) is true then, with a delay between 0 and 0.02, ElectronicTransmissionRangeState == 0 must be true
      VehicleSpeed: signal DevChallengeETRS/VehicleSpeed, port 1
      ElectronicTransmissionRangeSel: signal DevChallengeETRS/ElectronicTransmissionRangeSel, port 1
      ElectricParkBrakeApplied: signal DevChallengeETRS/ElectricParkBrakeApplied, port 1
      ElectricParkBrakeAvailable: signal DevChallengeETRS/ElectricParkBrakeAvailable, port 1
      ElectronicTransmissionRangeState: signal DevChallengeETRS/ETRS State Machine, port 7

  case "ETRS_3_2InvldShftSpd_(Moving foward; block reverse)" [baseline]
    description: When the vehicle is moving foward (>0.5 km/h), the system must not allow a shift into Reverse. I expect the assessment passes if the state never flips to Reverse.
    model DevChallengeETRS, mode Normal, start time 0, stop time 35
    input "ETRSInputs_3.2_forward.mat", mapped to ElectronicTransmissionRangeSel, ParktoChargeRequested, ElectricParkBrakeAvailable, ElectricParkBrakeApplied, Park_BrakePressed, VehicleSpeed, HVShutdownRequested, VehicleSystemEnabled (active)
    assessment "Assessment1": At any point of time, whenever (VehicleSpeed >= 0.5) & (ElectronicTransmissionRangeSel == 2) &(ElectricParkBrakeApplied == 2) & (ElectricParkBrakeAvailable == 1) & (VehicleSystemEnabled == 1) is true then, with no delay, ElectronicTransmissionRangeState ~= 3 must be true
      VehicleSpeed: signal DevChallengeETRS/VehicleSpeed, port 1
      ElectronicTransmissionRangeSel: signal DevChallengeETRS/ElectronicTransmissionRangeSel, port 1
      ElectricParkBrakeApplied: signal DevChallengeETRS/ElectricParkBrakeApplied, port 1
      ElectricParkBrakeAvailable: signal DevChallengeETRS/ElectricParkBrakeAvailable, port 1
      VehicleSystemEnabled: signal DevChallengeETRS/VehicleSystemEnabled, port 1
      ElectronicTransmissionRangeState: signal DevChallengeETRS/ETRS State Machine, port 7

  case "ETRS_3_2InvldShftSpd_(Moving backward; block drive)" [baseline]
    description: When the vehicle is moving backward (>0.5 km/h), the system must not allow a shift into Drive. I expect the assessment passes if the state never flips to Drive.
    model DevChallengeETRS, mode Normal, start time 0, stop time 35
    input "ETRSInputs_3.2_backward.mat", mapped to ElectronicTransmissionRangeSel, ParktoChargeRequested, ElectricParkBrakeAvailable, ElectricParkBrakeApplied, Park_BrakePressed, VehicleSpeed, HVShutdownRequested, VehicleSystemEnabled (active)
    assessment "Assessment1": At any point of time, whenever (VehicleSpeed >= 0.5) & (ElectronicTransmissionRangeSel == 4) &(ElectricParkBrakeApplied == 2) & (ElectricParkBrakeAvailable == 1) & (VehicleSystemEnabled == 1) is true then, with no delay, ElectronicTransmissionRangeState ~= 2 must be true
      VehicleSpeed: signal DevChallengeETRS/VehicleSpeed, port 1
      ElectronicTransmissionRangeSel: signal DevChallengeETRS/ElectronicTransmissionRangeSel, port 1
      ElectricParkBrakeApplied: signal DevChallengeETRS/ElectricParkBrakeApplied, port 1
      ElectricParkBrakeAvailable: signal DevChallengeETRS/ElectricParkBrakeAvailable, port 1
      VehicleSystemEnabled: signal DevChallengeETRS/VehicleSystemEnabled, port 1
      ElectronicTransmissionRangeState: signal DevChallengeETRS/ETRS State Machine, port 7

suite "ETRS4"

  case "ETRS_4_1BrkShftPrk" [baseline]
    description: The PSC shall not allow a shift out of PARK if the brake is not pressed.
    model DevChallengeETRS, mode Normal, start time 0, stop time 3510
    input "ETRSInputs_4.1_brake_before_shift.mat", mapped to ElectronicTransmissionRangeSel, ParktoChargeRequested, ElectricParkBrakeAvailable, ElectricParkBrakeApplied, Park_BrakePressed, VehicleSpeed, HVShutdownRequested, VehicleSystemEnabled (active)
    assessment "Assessment1": At any point of time, if (VehicleSpeed < 0.5) & (ElectronicTransmissionRangeSel == 4) & (ElectricParkBrakeApplied == 2) & (ElectricParkBrakeAvailable == 1) & (VehicleSystemEnabled == 1) & (Park_BrakePressed) becomes true then, with a delay between 0 and 0.02, ElectronicTransmissionRangeState ~= 0 must be true
    assessment "Enter's Drive Correctly after Neutral" (off): At any point of time, if (VehicleSpeed < 0.5) & (ElectronicTransmissionRangeSel == 4) & (ElectricParkBrakeApplied == 2) & (ElectricParkBrakeAvailable == 1) & (VehicleSystemEnabled == 1) & (Park_BrakePressed) becomes true then, with a delay between 0 and 0.02, ElectronicTransmissionRangeState == 2 must be true
      VehicleSpeed: signal DevChallengeETRS/VehicleSpeed, port 1
      ElectronicTransmissionRangeSel: signal DevChallengeETRS/ElectronicTransmissionRangeSel, port 1
      ElectricParkBrakeApplied: signal DevChallengeETRS/ElectricParkBrakeApplied, port 1
      ElectricParkBrakeAvailable: signal DevChallengeETRS/ElectricParkBrakeAvailable, port 1
      VehicleSystemEnabled: signal DevChallengeETRS/VehicleSystemEnabled, port 1
      Park_BrakePressed: signal DevChallengeETRS/Park_BrakePressed, port 1
      ElectronicTransmissionRangeState: signal DevChallengeETRS/ETRS State Machine, port 7

  case "ETRS_4_1BrkShftPrk_fail" [baseline]
    description: The PSC shall not allow a shift out of PARK if the brake is not pressed.
    model DevChallengeETRS, mode Normal, start time 0, stop time 35
    input "ETRSInputs_4.1_brake_before_shift_fail.mat", mapped to ElectronicTransmissionRangeSel, ParktoChargeRequested, ElectricParkBrakeAvailable, ElectricParkBrakeApplied, Park_BrakePressed, VehicleSpeed, HVShutdownRequested, VehicleSystemEnabled (active)
    assessment "Assessment1": At any point of time, whenever (VehicleSpeed < 0.5) & (ElectronicTransmissionRangeSel == 4) & (ElectricParkBrakeApplied == 2) & (ElectricParkBrakeAvailable == 1) & (VehicleSystemEnabled == 1) & (~Park_BrakePressed) is true then, with a delay between 0 and 0.02, ElectronicTransmissionRangeState == 0 must be true
      VehicleSpeed: signal DevChallengeETRS/VehicleSpeed, port 1
      ElectronicTransmissionRangeSel: signal DevChallengeETRS/ElectronicTransmissionRangeSel, port 1
      ElectricParkBrakeApplied: signal DevChallengeETRS/ElectricParkBrakeApplied, port 1
      ElectricParkBrakeAvailable: signal DevChallengeETRS/ElectricParkBrakeAvailable, port 1
      VehicleSystemEnabled: signal DevChallengeETRS/VehicleSystemEnabled, port 1
      Park_BrakePressed: signal DevChallengeETRS/Park_BrakePressed, port 1
      ElectronicTransmissionRangeState: signal DevChallengeETRS/ETRS State Machine, port 7